# Grasshopper definition Points_to_Lines.gh (Grasshopper 1.0.7)

# RMIT LA
# Design Research Seminar
# Fork It
connections = Slider(3, range=0..25)
min_distance = Slider(0, range=0..1000)
max_distance = Slider(5000, range=5..5000)
matches = Slider(8, range=0..100)
distance = Slider(7209, range=0..10000)

# ---- group: Manually Pick Points
# Each of the white groups represents a geometric logic that you could use to make a map.
# 
# The blue groups below contain the input data needed. You can replace these with one of the other blue groups to the right.
points = Point()

search_point_s = Point()
searched_points = Point()

search_point_s_2 = Point()
searched_points_2 = Point()

# ----
number = Number(connections)

# ---- group: Point Network (with minimum/maximum distance)
point = Point(flatten(points))
number_2 = Number(min_distance)
number_3 = Number(max_distance)
proximity_2d = Proximity2D(Points=point, Plane=PlaneXY(0, 0, 0), Group=number, MinRadius=number_2, MaxRadius=number_3)  # -> Links, Topology
geometry = Geometry(proximity_2d.Links)

# ---- group: Get evenly-spaced points on Curves
curve = Curve(<curve referenced from the Rhino model>)
divide_distance = DivideDistance(Curve=curve, Distance=Slider(270, range=0..1000))  # -> Points, Tangents, Parameters
point_2 = Point(divide_distance.Points)

# ---- group: Get point on a Curve (even if it is not closed)
curve_2 = Curve([<curve referenced from the Rhino model> x186])
point_on_curve = PointOnCurve(curve_2, parameter=0.5)
point_3 = Point(point_on_curve)

# ---- group: Get Centerpoints of a Polyline (if they are closed)
curve_3 = Curve()
polygon_center = PolygonCenter(Polyline=curve_3)  # -> CenterV, CenterE, CenterA
clean_tree = CleanTree(RemoveNulls=True, RemoveInvalid=True, RemoveEmpty=False, Tree=polygon_center.CenterA)
point_4 = Point(clean_tree)

# ---- group: Automatically pick all points from a layer
geometry_pipeline = GeometryPipeline(
    GroupByLayer=False,
    GroupByType=False,
    IncludeHidden=True,
    IncludeLocked=True,
    LayerFilter="*",
    NameFilter="*",
    SublayerFiltering=True,
    TypeFilter=1)
group = Group(geometry_pipeline)

# ---- group: Attempt to close curves automatically (will only work if there is one small gap)
curve_4 = Curve([<curve referenced from the Rhino model> x186])
cluster = Cluster(curve=curve_4)  # -> unclosable_curves_2, closed_curves_3
curve_5 = Curve(cluster.closed_curves_3)

# ----
geometry_2 = Geometry(geometry)
custom_preview = CustomPreview(Geometry=geometry_2, Material=ColourSwatch(SwatchColor=RGB(0, 255, 0)))

# ---- group: Closest Points to a Single Point (set number)
point_5 = Point(graft(search_point_s))
point_6 = Point(flatten(searched_points))
closest_points = ClosestPoints(Point=point_5, Cloud=point_6, Count=matches)  # -> ClosestPoint, CPIndex, Distance

# ----
line = Line(StartPoint=point_5, EndPoint=closest_points.ClosestPoint)

# ---- group: Closest Points to a Single Point (set number) (continued)
geometry_3 = Geometry(line)

# ----
geometry_4 = Geometry(geometry_3)
custom_preview_2 = CustomPreview(Geometry=geometry_4, Material=ColourSwatch(SwatchColor=RGB(247, 255, 0)))

# ---- group: Closest Points to a Single Point (by maximum distance)
point_7 = Point(graft(search_point_s_2))
point_8 = Point(flatten(searched_points_2))
distance_2 = Distance(PointA=point_7, PointB=point_8)
smaller_than = SmallerThan(FirstNumber=distance_2, SecondNumber=distance)  # -> SmallerThan, OrEqualTo
cull_pattern = CullPattern(List=point_8, CullPattern=smaller_than.SmallerThan)

# ----
line_2 = Line(StartPoint=point_7, EndPoint=cull_pattern)

# ---- group: Closest Points to a Single Point (by maximum distance) (continued)
curve_6 = Curve(line_2)

# ----
curve_7 = Curve(curve_6)
custom_preview_3 = CustomPreview(Geometry=curve_7, Material=ColourSwatch(SwatchColor=RGB(0, 255, 255)))

# ==== cluster Cluster
curve = ClusterInput()
curve_2 = Curve(curve)
closed = Closed(Curve=curve_2)  # -> Closed, Periodic
cull_pattern = CullPattern(List=curve_2, CullPattern=invert(closed.Closed))
cull_pattern_2 = CullPattern(List=curve_2, CullPattern=closed.Closed)
join_curves = JoinCurves(Curves=cull_pattern, Preserve=False)
closed_2 = Closed(Curve=join_curves)  # -> Closed, Periodic
cull_pattern_3 = CullPattern(List=join_curves, CullPattern=invert(closed_2.Closed))  # -> graft(List)
cull_pattern_4 = CullPattern(List=join_curves, CullPattern=closed_2.Closed)
end_points = EndPoints(Curve=cull_pattern_3)  # -> Start, End
line = Line(StartPoint=end_points.Start, EndPoint=end_points.End)
join_curves_2 = JoinCurves(Curves=[cull_pattern_3, line], Preserve=False)
curve_3 = Curve(flatten(join_curves_2))
closed_3 = Closed(Curve=curve_3)  # -> Closed, Periodic
cull_pattern_5 = CullPattern(List=curve_3, CullPattern=invert(closed_3.Closed))
cull_pattern_6 = CullPattern(List=curve_3, CullPattern=closed_3.Closed)
closed_via_stitch = Curve(cull_pattern_6)
already_closed_curves = Curve(cull_pattern_2)
closed_via_joins = Curve(cull_pattern_4)
closed_curves = Curve(flatten([closed_via_stitch, closed_via_joins, already_closed_curves]))
null_item = NullItem(Item=closed_curves)  # -> NullFlags, InvalidFlags, Description
cull_pattern_7 = CullPattern(List=closed_curves, CullPattern=null_item.InvalidFlags)
cull_pattern_8 = CullPattern(List=closed_curves, CullPattern=invert(null_item.InvalidFlags))
unclosable_curves = Curve(flatten([cull_pattern_5, cull_pattern_7]))
closed_curves_2 = Curve(flatten(cull_pattern_8))
closed_curves_3 = ClusterOutput(closed_curves_2)
unclosable_curves_2 = ClusterOutput(unclosable_curves)
